# Grasshopper definition antworld_test.gh (Grasshopper 0.9.72)
# plug-ins: Ants

number_slider = Slider(10, range=2..30)
gridworld = AntsGridWorld(Rows=number_slider, NumberOfColumns=number_slider, ConnectCorners=Toggle(True))
aworld = AntsWorld(gridworld)
panel = Panel(aworld)
worldtolines = AntsGridToLines(AWorld=gridworld)
panel_2 = Panel(worldtolines)
